# Grasshopper definition example.ghx (Grasshopper 1.0.8)
# plug-ins: Speckle 2, CORE.Toolbox.Grasshopper, GhPython Script, Bifocals, Kangaroo2 Components

panel = Panel("https://macad.speckle.xyz/projects/a932e194ee/models/5001ef0d3c")

# ---- group: RH_IN:Send
txt = Text()

# ----
synchronous_receiver = SynchronousReceiver(
    Stream=panel,
    AutoReceive=False,
    ReceivedObjectId="3f45d38656530560f808ccec9cc4cf23",
    StreamWrapper="https://macad.speckle.xyz/projects/a932e194ee/models/5001ef0d3c",
    selectedKitName="Objects")  # -> Data, Info
sovk = SpeckleObjectValueByKey(Object=synchronous_receiver.Data, Key="elements", selectedKitName="Objects")
sovk_2 = SpeckleObjectValueByKey(Object=sovk, Key="elements", selectedKitName="Objects")
sovk_3 = SpeckleObjectValueByKey(Object=sovk_2, Key="parameters", selectedKitName="Objects")

sovk_4 = SpeckleObjectValueByKey(Object=sovk_3, Key="faae278b-7fcd-4840-9d5c-fcd1cb2c4068", selectedKitName="Objects")
sovk_5 = SpeckleObjectValueByKey(Object=sovk_4, Key="name", selectedKitName="Objects")
sovk_6 = SpeckleObjectValueByKey(Object=sovk_4, Key="value", selectedKitName="Objects")
panel_2 = Panel(sovk_5)
panel_3 = Panel(sovk_6)

sovk_7 = SpeckleObjectValueByKey(Object=sovk_3, Key="87c493a7-09c4-42fb-8bfb-c683efe1bbf7", selectedKitName="Objects")
sovk_8 = SpeckleObjectValueByKey(Object=sovk_7, Key="name", selectedKitName="Objects")
sovk_9 = SpeckleObjectValueByKey(Object=sovk_7, Key="value", selectedKitName="Objects")
panel_4 = Panel(sovk_9)
panel_5 = Panel(sovk_8)

speckle_object = SpeckleObject(sovk_2)
list_length = ListLength()
panel_6 = Panel(speckle_object)
sovk_10 = SpeckleObjectValueByKey(Object=sovk_2, Key="displayValue", selectedKitName="Objects")
panel_7 = Panel(sovk_10)
mesh_join = MeshJoin(Meshes=sovk_10)
deconstruct_mesh = DeconstructMesh(Mesh=mesh_join)  # -> flatten(Vertices), Faces, Colours, Normals
deconstruct = Deconstruct(Point=deconstruct_mesh.Vertices)  # -> XComponent, YComponent, ZComponent
bounds = Bounds(Numbers=deconstruct.ZComponent)
lvl_2_floor_boundary = Curve(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)
deconstruct_domain = DeconstructDomain(Domain=bounds)  # -> Start, End
panel_9 = Panel(deconstruct.ZComponent)
equality = Equality(FirstNumber=deconstruct.ZComponent, SecondNumber=deconstruct_domain.End)  # -> Equality, Inequality
send = Send(AutoSend=False, CurrentComponentState="needs_input", KitName="Objects", UseDefaultCache=True, selectedKitName="Objects")
panel_10 = Panel(equality.Equality)
cull_pattern = CullPattern(List=deconstruct_mesh.Vertices, CullPattern=equality.Equality)
clean_duplicate_points = CleanDuplicatePoints(Points=cull_pattern, Tolerance=0.01)  # -> Points, Indices, Status
point = Point(clean_duplicate_points.Points)
polyline = PolyLine(Vertices=point, Closed=True)
relay = Relay()
surface = Surface(relay)
deconstruct_speckle_object = DeconstructSpeckleObject(SpeckleObject=sovk_2, selectedKitName="Objects")  # -> BuiltInCategory, Category, DisplayValue, ElementId, Elements, Family, IsRevitLinkedModel, Level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
create_speckle_object = CreateSpeckleObject(selectedKitName="Objects")
number_slider = Slider(0, range=0..100)
change_project_for_streams = Panel("https://macad.speckle.xyz/streams/011d53483d")

sgetwt = StreamGetWithToken(Stream=change_project_for_streams, AuthToken="0a7a2c01a136ad89e2cfa5e002c9f1bcbe5656a1d0")

panel_11 = Panel("Receive_From_Compute Stream")
panel_12 = Panel("Bot Speckle Token")

# ---- group: RH_IN:Receive
txt_2 = Text()

# ----
trigger = Trigger(Interval=-1000, TimerInterval=1000, Target=ss)
speckle_schema_object = RevitMaterial(
    SelectedConstructorName="Objects.Other.Material.ctor(System.String)",
    SelectedTypeName="Objects.Other.Material",
    UseSchemaTag=False,
    UserSetSchemaTag=False,
    seed="07faeb687897d37008da")

min_area_for_each_unit_m_unit² = Slider(359, range=0..4000)
curve = Curve(polyline)
divide = DivideCurve(Curve=curve, Count=Slider(82, range=0..500), Kinks=False)  # -> Points, Tangents, Parameters
boundary = BoundarySurfaces(Edges=curve)
voronoi = Voronoi(Points=divide.Points, BruteForceOverride=False)
explode = Explode(Curve=voronoi, Recursive=True)  # -> flatten(Segments), Vertices
dupln = RemoveDuplicateLines(Lines=explode.Segments, Tolerance=0.01)
srfsplit = SurfaceSplit(Surface=boundary, Curves=dupln)
debrep = DeconstructBrep(Brep=srfsplit)  # -> Faces, Edges, Vertices
curvepoint = PointOnCurve(debrep.Edges, parameter=0.5)
crv_cp = CurveClosestPoint(Point=curvepoint, Curve=curve)  # -> Point, Parameter, Distance
sort = SortList(Keys=crv_cp.Distance, ValuesA=crv_cp.Point)  # -> Keys, ValuesA
item = ListItem(List=sort.ValuesA, Index=0, Wrap=True)  # -> flatten(Item)
alongcrv = SortAlongCurve(Points=item, Curve=curve)  # -> Points, Indices
item_2 = ListItem(List=srfsplit, Index=alongcrv.Indices, Wrap=True)
area = Area(Geometry=item_2)  # -> Area, Centroid
ma = MassAddition(Input=area.Area)  # -> Result, PartialResults
division = Division(A=ma.Result, B=min_area_for_each_unit_m_unit²)
int = Integer(division)
dom = ConstructDomain(DomainStart="0", DomainEnd=ma.Result)
div = DivideDomain(Domain=dom, Count=int)
inc = Includes(Value=ma.PartialResults, Domain=graft(div))  # -> Includes, Deviation
dispatch = Dispatch(List=item_2, DispatchPattern=inc.Includes)  # -> ListA, ListB
join = BrepJoin(Breps=dispatch.ListA)  # -> Breps, Closed
medges = MeshEdges(Mesh=join.Breps)  # -> NakedEdges, InteriorEdges, NonManifoldEdges
mesh = Mesh(join.Breps)
mjoin = MeshJoin(Meshes=mesh)  # -> flatten(Mesh)
list_item = ListItem(List=mjoin, Index=Slider(10, range=1..23), Wrap=True)
lng = ListLength(List=mjoin)
mesh_2 = Mesh(list_item)
area_2 = Area(Geometry=mjoin)  # -> Area, Centroid
panel_13 = Panel(area_2.Area)

area_3 = Area(Geometry=curve)  # -> Area, Centroid
list_item_2 = ListItem(List=area_3.Centroid, Index=0, Wrap=True)

curve_2 = Curve(flatten(medges.NakedEdges))
crvs = Curves([<curves referenced from the Rhino model> x4])
offset_int = OffsetIntersection(Curves=curve_2, Plane=list_item_2, InOffset=Slider(1.17, range=0..10))  # -> Outer, Inner
srf = Surface(offset_int.Inner)
Z = UnitZ(Factor=expr("-x", Slider(1.05, range=0..2)))
extr = Extrude(Base=srf, Direction=Z)
edges = BrepEdges(Brep=extr)  # -> Naked, Interior, NonManifold
preview = CustomPreview(
    Geometry=extr,
    Material={diffuse=RGB(255, 190, 0), emission=RGB(76, 64, 0), shine=0, specular=RGB(255, 255, 255), transparency=0})

preview_2 = CustomPreview(Geometry=srf, Material=ColourSwatch(SwatchColor=RGB(86, 109, 140)))

curve_3 = Curve(srf)
area_4 = Area(Geometry=srf)  # -> Area, Centroid
panel_14 = Panel(area_4.Area)
scale = Scale(Geometry=srf, Center=area_4.Centroid, Factor=Slider(1, range=0..1))  # -> Geometry, Transform
lng_2 = ListLength(List=scale.Geometry)
random = Random(Range="0 to 100", Number=lng_2, Seed=2)
create_speckle_object_by_key_value = CreateSpeckleObjectByKeyValue(Keys=random, selectedKitName="Objects")
speckle_schema_object_2 = RevitFloor(
    Family=deconstruct_speckle_object.Family,
    Type=deconstruct_speckle_object.Type,
    Outline=curve_3,
    Level=deconstruct_speckle_object.Level,
    Structural=deconstruct_speckle_object.Structural,
    Slope=0,
    SelectedConstructorName="Objects.BuiltElements.Revit.RevitFloor.ctor(System.String,System.String,Objects.ICurve,Objects.BuiltElements.Level,System.Boolean,System.Double,Objects.Geometry.Line,System.Collections.Generic.List`1[Objects.ICurve],System.Collections.Generic.List`1[Speckle.Core.Models.Base],System.Collections.Generic.List`1[Objects.BuiltElements.Revit.Parameter])",
    SelectedTypeName="Objects.BuiltElements.Revit.RevitFloor",
    UseSchemaTag=False,
    UserSetSchemaTag=False,
    seed="b0301e73536e95921f9c")

# ---- group: RH_OUT:Cost
num = Number(random)

# ----
cso = CreateSpeckleObject(FLOOR=speckle_schema_object_2, Cost=num, selectedKitName="Objects")
panel_15 = Panel(num)
ss = SynchronousSender(
    Data=cso,
    Stream=sgetwt,
    OutputWrappers="https://macad.speckle.xyz\t011d53483d\t2c5960aba1",
    UseDefaultCache=True,
    selectedKitName="Objects")  # disabled
